% Simulink data dictionary pid.sldd

pid_param = Simulink.Bus()
  P: double
  I: double
  D: double
  N: double

pid = Simulink.Parameter(struct(P=2, I=22, D=0.05, N=1000), StorageClass="SimulinkGlobal", DataType="Bus: pid_param")
T_sample_control = 0.001
g = [0 0 -9.81]
Sig = Simulink.Signal()